# Grasshopper definition hops_geom_test.gh (Grasshopper 1.0.8)

get_geometry = GetGeometry(AnnotationTypeFilter=3966, AtLeast=1, AtMost=1, DeleteInput=False, Filter=1074081855, TreeAccess=False)
number = Number(5)
fillet = Fillet(Curve=get_geometry, Radius=number)
context_bake = ContextBake(Content=fillet)
