# Grasshopper definition jeroen_test.gh (Grasshopper 1.0.8)

länge = Slider(5, range=1..5)
länge_2 = Slider(5, range=1..5)
number_slider = Slider(1, range=0..1)

get_string = GetString("test string", AtLeast=1, AtMost=1, TreeAccess=False)

# ---- group: Inputs
length = GetNumber(länge_2, AtLeast=1, AtMost=1, Maximum=20, Minimum=0, TreeAccess=False)

# ----
number_slider_2 = Slider(2, range=0..2)

transform = GetNumber(länge, AtLeast=1, AtMost=1, Maximum=20, Minimum=0, TreeAccess=False)

vector_xyz = VectorXYZ(XComponent=transform, YComponent=transform, ZComponent=transform)  # -> Vector, Length
rectangle = Rectangle(Plane=PlaneXY(0, 0, 0), XSize=Domain(-1, 1), YSize=Domain(-2, 2), Radius=0)  # -> Rectangle, Length
transform_2 = Transform(vector_xyz.Vector)
box_rectangle = BoxRectangle(Rectangle=rectangle.Rectangle, Height=length)
transform_3 = Transform(Geometry=box_rectangle, Transform=transform_2)
mesh_sphere = MeshSphere(Base=PlaneXY(0, 0, 0), Radius=length, UCount=10, VCount=20)
mesh = Mesh(mesh_sphere)
mesh_2 = Mesh(transform_3)
