# Grasshopper definition newparkinghops.gh (Grasshopper 1.0.8)
# plug-ins: Rhino.Grasshopper.Plugin.Parkeren

get_geometry = GetGeometry(AnnotationTypeFilter=3966, AtLeast=1, AtMost=1, DeleteInput=False, Filter=1074081855, TreeAccess=False)
parkerencomponent = ParkerenComponent(Plot=get_geometry)  # -> Roads, Spots, Points
curve = Curve(parkerencomponent.Roads)
context_bake = ContextBake(Content=curve)
