# Grasshopper definition parkingcompute.gh (Grasshopper 1.0.8)
# plug-ins: Rhino.Grasshopper.Plugin.Parkeren

get_geometry = GetGeometry(AnnotationTypeFilter=3966, AtLeast=1, AtMost=1, DeleteInput=False, Filter=1074081855, TreeAccess=False)
point = Point([<point referenced from the Rhino model> x2])
curve = Curve(get_geometry)
parkerencomponent = ParkerenComponent(Plot=curve, Access=point)  # -> Roads, Spots, Points
panel = Panel(parkerencomponent.Points)
panel_2 = Panel(parkerencomponent.Roads)
curve_2 = Curve(parkerencomponent.Roads)
panel_3 = Panel(curve_2)
