# Grasshopper definition pathfinding_internalized.gh (Grasshopper 1.0.8)
# plug-ins: RhinoCodePluginGH

mesh_colours = MeshColours(Mesh=[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], Colours=ColourSwatch(SwatchColor=RGB(0, 255, 255)))
mesh_colours_2 = MeshColours(Mesh=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, Colours=ColourSwatch(SwatchColor=RGB(255, 255, 0)))
mesh_colours_3 = MeshColours(Mesh=[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], Colours=ColourSwatch(SwatchColor=RGBA(57, 53, 0, 133)))
number_slider = Slider(1, range=0..1)
number_slider_2 = Slider(1, range=0..1)
deconstruct_mesh = DeconstructMesh(Mesh=mesh_colours)  # -> Vertices, Faces, Colours, Normals
unit_z = UnitZ(Factor=1)
deconstruct_mesh_2 = DeconstructMesh(Mesh=mesh_colours_2)  # -> Vertices, Faces, Colours, Normals
unit_z_2 = UnitZ(Factor=1)
radians = Radians(Degrees=Slider(90, range=0..100))
radians_2 = Radians(Degrees=Slider(90, range=0..100))
list_item = ListItem(List=deconstruct_mesh.Vertices, Index=number_slider, Wrap=True)
list_item_2 = ListItem(List=deconstruct_mesh.Normals, Index=number_slider, Wrap=True)
list_item_3 = ListItem(List=deconstruct_mesh_2.Normals, Index=number_slider_2, Wrap=True)
list_item_4 = ListItem(List=deconstruct_mesh_2.Vertices, Index=number_slider_2, Wrap=True)
rotate = Rotate(Vector=list_item_2, Axis=unit_z_2, Angle=radians_2)
rotate_2 = Rotate(Vector=list_item_3, Axis=unit_z, Angle=radians)
expression = Expression(x=rotate, y=Slider(20, range=0..100), Expression="y * x")
expression_2 = Expression(x=rotate_2, y=Slider(38, range=0..100), Expression="y * x")
move = Move(Geometry=list_item_4, Motion=expression_2)  # -> Geometry, Transform
deconstruct = Deconstruct(Point=move.Geometry)  # -> XComponent, YComponent, ZComponent
number_slider_3 = Slider(70, range=0..100)
number_slider_4 = Slider(7, range=0..100)
move_2 = Move(Geometry=list_item, Motion=expression)  # -> flatten(Geometry), Transform
expression_3 = Expression(x=number_slider_4, Expression="x / 2")
rectangular = Rectangular(Plane=PlaneXY(0, 0, 0), SizeX=number_slider_4, SizeY=number_slider_4, ExtentX=number_slider_3, ExtentY=number_slider_3)  # -> Cells, Points
unit_z_3 = UnitZ(Factor=1)
vector_xyz = VectorXYZ(XComponent=expression_3, YComponent=expression_3, ZComponent=deconstruct.ZComponent)  # -> Vector, Length
negative = Negative(Value=unit_z_3)
move_3 = Move(Geometry=rectangular.Points, Motion=vector_xyz.Vector)  # -> flatten(Geometry), Transform
mesh_ray = MeshRay(Mesh=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, Point=move_3.Geometry, Direction=negative)  # -> Point, Hit
expression_4 = Expression(x=mesh_ray.Hit, Expression="Not x")
afgiftepunt = GetNumber(Slider(17, range=0..39), AtLeast=1, AtMost=1, Maximum=1.797693135e+308, Minimum=-1.797693135e+308, TreeAccess=False)
closest_point = ClosestPoint(Point=move_2.Geometry, Cloud=move_3.Geometry)  # -> ClosestPoint, CPIndex, Distance
closest_point_2 = ClosestPoint(Point=move.Geometry, Cloud=move_3.Geometry)  # -> ClosestPoint, CPIndex, Distance
cull_pattern = CullPattern(List=move_3.Geometry, CullPattern=expression_4)
merge = Merge(Data1=closest_point.ClosestPoint, Data2=closest_point_2.ClosestPoint, Data3=cull_pattern)  # -> flatten(Result)
number_slider_5 = Slider(3, range=0..10)
panel = Panel(merge)
list_item_5 = ListItem(List=closest_point.ClosestPoint, Index=afgiftepunt, Wrap=True)
sphere = Sphere(Base=closest_point_2.ClosestPoint, Radius=number_slider_5)
sphere_2 = Sphere(Base=list_item_5, Radius=number_slider_5)
c_script = CSharpScript(startPoint=closest_point_2.ClosestPoint, endPoint=list_item_5, searchGrid=merge)  # -> out, Path; inputs searchGrid: list
# ---------- c_script: C# ----------
// Grasshopper Script Instance
#region Usings
using System;
using System.Linq;
using System.Collections;
using System.Collections.Generic;
using System.Drawing;

using Rhino;
using Rhino.Geometry;

using Grasshopper;
using Grasshopper.Kernel;
using Grasshopper.Kernel.Data;
using Grasshopper.Kernel.Types;
#endregion

public class Script_Instance : GH_ScriptInstance
{
    #region Notes
    /* 
      Members:
        RhinoDoc RhinoDocument
        GH_Document GrasshopperDocument
        IGH_Component Component
        int Iteration

      Methods (Virtual & overridable):
        Print(string text)
        Print(string format, params object[] args)
        Reflect(object obj)
        Reflect(object obj, string method_name)
    */
    #endregion


    public class Node
    {
        public Point3d Position { get; set; }
        public Node Parent { get; set; }
        public double G { get; set; }
        public double H { get; set; }
        public double F => G + H;
        public Vector3d? Direction { get; set; }  // Nullable to indicate initial undefined direction

        public Node(Point3d position)
        {
            Position = position;
            G = double.MaxValue;
            H = 0;
            Parent = null;
            Direction = null;
        }

        public override bool Equals(object obj)
        {
            if (obj is Node other)
                return Position.Equals(other.Position);
            return false;
        }

        public override int GetHashCode()
        {
            return Position.GetHashCode();
        }
    }

    private static List<Node> GetNeighbors(Node node, List<Point3d> searchGrid, Dictionary<Point3d, Node> nodeLookup)
    {
        var neighbors = new List<Node>();
        double neighborDistance = 8;  // Define neighbor threshold distance as needed

        foreach (var point in searchGrid)
        {
            if (point.DistanceTo(node.Position) < neighborDistance && !point.Equals(node.Position))
            {
                neighbors.Add(nodeLookup[point]);
            }
        }

        return neighbors;
    }

    private static double GetHeuristic(Point3d a, Point3d b)
    {
        return a.DistanceTo(b);
    }

    private static List<Point3d> ReconstructPath(Node node)
    {
        var path = new List<Point3d>();
        while (node != null)
        {
            path.Add(node.Position);
            node = node.Parent;
        }
        path.Reverse();
        return path;
    }

    public static List<Point3d> AStarPathfinding(Point3d startPoint, Point3d endPoint, List<Point3d> searchGrid)
    {
        Node startNode = new Node(startPoint) { G = 0, H = GetHeuristic(startPoint, endPoint) };
        Node endNode = new Node(endPoint);

        var openSet = new List<Node> { startNode };
        var closedSet = new HashSet<Node>();

        var nodeLookup = new Dictionary<Point3d, Node>();
        foreach (var point in searchGrid)
        {
            nodeLookup[point] = new Node(point);
        }

        while (openSet.Count > 0)
        {
            var current = openSet.OrderBy(n => n.F).First();

            if (current.Position.Equals(endPoint))
                return ReconstructPath(current);

            openSet.Remove(current);
            closedSet.Add(current);

            foreach (var neighbor in GetNeighbors(current, searchGrid, nodeLookup))
            {
                if (closedSet.Contains(neighbor))
                    continue;

                // Calculate movement direction from current to neighbor
                Vector3d direction = neighbor.Position - current.Position;
                direction.Unitize();

                // Calculate turn cost if direction changes
                double turnCost = 0;
                if (current.Direction.HasValue && current.Direction.Value != direction)
                {
                    turnCost = 1.5;  // Adjust as needed to influence path
                }

                // Total cost to reach neighbor, including turn cost
                double tentativeG = current.G + current.Position.DistanceTo(neighbor.Position) + turnCost;

                if (tentativeG < neighbor.G || !openSet.Contains(neighbor))
                {
                    neighbor.Parent = current;
                    neighbor.G = tentativeG;
                    neighbor.H = GetHeuristic(neighbor.Position, endPoint);
                    neighbor.Direction = direction;  // Set direction for neighbor

                    if (!openSet.Contains(neighbor))
                        openSet.Add(neighbor);
                }
            }
        }

        return null;
    }
 

    private void RunScript(
	object startPoint,
	object endPoint,
	List<object> searchGrid,
	ref object Path)
    {
    
        Rhino.Geometry.Point3d startNode = (Rhino.Geometry.Point3d)startPoint;
        Rhino.Geometry.Point3d goalNode = (Rhino.Geometry.Point3d)endPoint;
        List<Rhino.Geometry.Point3d> pointGrid = searchGrid.Cast<Rhino.Geometry.Point3d>().ToList();

        List<Rhino.Geometry.Point3d> pathArray = new List<Rhino.Geometry.Point3d>();

        // Perform A* pathfinding
        var path = AStarPathfinding(startNode, goalNode, pointGrid);

        // Output the path
        if (path != null)
        {
            Console.WriteLine("Path found:");
            foreach (var point in path)
            {
                pathArray.Add(point);
            }
            Path = pathArray;
        } 
        else
        {
            Console.WriteLine("No path found.");
        }
    }
}
# ---------- end c_script ----------
mesh_colours_4 = MeshColours(Mesh=sphere_2, Colours=ColourSwatch(SwatchColor=RGB(0, 255, 0)))
mesh_colours_5 = MeshColours(Mesh=sphere, Colours=ColourSwatch(SwatchColor=RGB(255, 0, 0)))
polyline = PolyLine(Vertices=c_script.Path, Closed=False)
pipe = Pipe(Curve=polyline, Radius=Slider(3, range=0..10), Caps=0)
mesh_colours_6 = MeshColours(Mesh=pipe, Colours=ColourSwatch(SwatchColor=RGB(255, 0, 255)))
context_bake = ContextBake(Content=[mesh_colours, mesh_colours_2, mesh_colours_3, mesh_colours_4, mesh_colours_5, mesh_colours_6])
