# Grasshopper definition skid_poc.gh (Grasshopper 1.0.8)

# ---- group: Inputs / Luchtkanalen
breedte = Slider(15, range=2..16, expression="x*50")
hoogte = Slider(8, range=1..8, expression="x*50")
aanwezig = BooleanToggle(False)
luchtaanwezig = GetBoolean(aanwezig, AtLeast=1, AtMost=1, FalseValue="False", TreeAccess=False, TrueValue="True")
luchthoogte = GetNumber(hoogte, AtLeast=1, AtMost=1, Maximum=1.797693135e+308, Minimum=-1.797693135e+308, TreeAccess=False)
luchtbreedte = GetNumber(breedte, AtLeast=1, AtMost=1, Maximum=1.797693135e+308, Minimum=-1.797693135e+308, TreeAccess=False)

# ---- group: Inputs / Skid
lengte = Slider(9, range=4..9, expression="x*600")
profieltype = ValueList({"One": 40, "Two": 50, "Three": 90}, selected="Two")
skidlengte = GetNumber(lengte, AtLeast=1, AtMost=1, Maximum=5400, Minimum=2400, TreeAccess=False)
profieltype_2 = GetNumber(profieltype, AtLeast=1, AtMost=1, Maximum=5400, Minimum=-1.797693135e+308, TreeAccess=False)

# ---- group: Inputs / Elektra
hoogte_2 = Slider(10, range=6..10, expression="x*10")
breedte_2 = Slider(60, range=10..60, expression="x*10")
aanwezig_2 = BooleanToggle(True)
elektraaanwezig = GetBoolean(aanwezig_2, AtLeast=1, AtMost=1, FalseValue="False", TreeAccess=False, TrueValue="True")
elektrahoogte = GetNumber(hoogte_2, AtLeast=1, AtMost=1, Maximum=1.797693135e+308, Minimum=-1.797693135e+308, TreeAccess=False)
elektrabreedte = GetNumber(breedte_2, AtLeast=1, AtMost=1, Maximum=1.797693135e+308, Minimum=-1.797693135e+308, TreeAccess=False)

# ---- group: Inputs / Klimaat (Verwarming/Koeling)
diameter = Slider(5, range=1..5, expression="x*50")
aanwezig_3 = BooleanToggle(True)
klimaataanwezig = GetBoolean(aanwezig_3, AtLeast=1, AtMost=1, FalseValue="False", TreeAccess=False, TrueValue="True")
klimaatdiameter = GetNumber(diameter, AtLeast=1, AtMost=1, Maximum=1.797693135e+308, Minimum=-1.797693135e+308, TreeAccess=False)

# ---- group: Inputs / Water
diameter_2 = Slider(28, range=12..28)
aanwezig_4 = BooleanToggle(True)
wateraanwezig = GetBoolean(aanwezig_4, AtLeast=1, AtMost=1, FalseValue="False", TreeAccess=False, TrueValue="True")
waterdiameter = GetNumber(diameter_2, AtLeast=1, AtMost=1, Maximum=1.797693135e+308, Minimum=-1.797693135e+308, TreeAccess=False)

# ----
expression = Expression(SkidLengte=skidlengte, Expression="Floor(SkidLengte / 1200)")
expression_2 = Expression(ProfielType=profieltype_2, Expression="ProfielType / 2")

# ---- group: Elektra
expression_3 = Expression(
    ProfielType=profieltype_2,
    ProfielHalfDikte=expression_2,
    LuchtAanwezig=luchtaanwezig,
    LuchtBreedte=luchtbreedte,
    Expression="If(LuchtAanwezig, ProfielHalfDikte + 2*75 + LuchtBreedte + ProfielType + 50 , ProfielHalfDikte + 50)")
expression_4 = Expression(ProfielHalfDikte=expression_2, ElektraHoogte=elektrahoogte, Expression="ProfielHalfDikte + 2*50 + ElektraHoogte")

# ---- group: Lucht / LuchtKanalen / LuchtKanaalBoven / Positie Linksonder
luchtkanaal_onder = Expression(ProfielHalfDikte=expression_2, LuchtHoogte=luchthoogte, Expression="ProfielHalfDikte + 2*75 + LuchtHoogte")
luchtkanaal_onder_2 = Expression(ProfielHalfDikte=expression_2, Expression="ProfielHalfDikte + 75")

# ---- group: Lucht / LuchtKanalen / LuchtKanaal Onder / Positie Linksonder
luchtkanaal_onder_3 = Expression(ProfielHalfDikte=expression_2, Expression="ProfielHalfDikte + 75")

# ---- group: Lucht / LuchtKanalen / LuchtKanaal Onder
domain_box = DomainBox(Base=PlaneXY(0, 0, 0), X=luchtbreedte, Y=skidlengte, Z=luchthoogte)
vector_xyz = VectorXYZ(XComponent=luchtkanaal_onder_3, YComponent=0, ZComponent=luchtkanaal_onder_3)  # -> Vector, Length
transform = Transform(Geometry=domain_box, Transform=vector_xyz.Vector)
mesh_colours = MeshColours(Mesh=transform, Colours=ColourSwatch(SwatchColor=RGB(0, 0, 126)))

# ---- group: Lucht / LuchtKanalen / LuchtKanaalBoven
domain_box_2 = DomainBox(Base=PlaneXY(0, 0, 0), X=luchtbreedte, Y=skidlengte, Z=luchthoogte)
vector_xyz_2 = VectorXYZ(XComponent=luchtkanaal_onder_2, YComponent=0, ZComponent=luchtkanaal_onder)  # -> Vector, Length
transform_2 = Transform(Geometry=domain_box_2, Transform=vector_xyz_2.Vector)
mesh_colours_2 = MeshColours(Mesh=transform_2, Colours=ColourSwatch(SwatchColor=RGB(0, 154, 0)))

# ---- group: Elektra / ElektraLeiding Boven
domain_box_3 = DomainBox(Base=PlaneXY(0, 0, 0), X=elektrabreedte, Y=skidlengte, Z=elektrahoogte)
vector_xyz_3 = VectorXYZ(XComponent=expression_3, YComponent=0, ZComponent=expression_4)  # -> Vector, Length
transform_3 = Transform(Geometry=domain_box_3, Transform=vector_xyz_3.Vector)
mesh_colours_3 = MeshColours(Mesh=transform_3, Colours=ColourSwatch(SwatchColor=RGB(205, 181, 0)))

# ---- group: Elektra / ElektraLeiding Onder
domain_box_4 = DomainBox(Base=PlaneXY(0, 0, 0), X=elektrabreedte, Y=skidlengte, Z=elektrahoogte)
expression_5 = Expression(ProfielHalfDikte=expression_2, Expression="ProfielHalfDikte + 50")
vector_xyz_4 = VectorXYZ(XComponent=expression_3, YComponent=0, ZComponent=expression_5)  # -> Vector, Length
transform_4 = Transform(Geometry=domain_box_4, Transform=vector_xyz_4.Vector)
mesh_colours_4 = MeshColours(Mesh=transform_4, Colours=ColourSwatch(SwatchColor=RGB(205, 181, 0)))

# ---- group: Lucht / LuchtKanalen
stream_filter = StreamFilter(Gate=luchtaanwezig, Stream1=[mesh_colours_2, mesh_colours])

# ---- group: Elektra
stream_filter_2 = StreamFilter(Gate=elektraaanwezig, Stream1=[mesh_colours_3, mesh_colours_4])

# ----
expression_6 = Expression(ProfielHalfDikte=expression_2, Expression="-2*ProfielHalfDikte")

# ---- group: Klimaat
expression_7 = Expression(KlimaatDiameter=klimaatdiameter, Expression="KlimaatDiameter / 2")
expression_8 = Expression(
    ProfielType=profieltype_2,
    ProfielHalfDikte=expression_2,
    LuchtAanwezig=luchtaanwezig,
    LuchtBreedte=luchtbreedte,
    KlimaatRadius=expression_7,
    Expression="If (LuchtAanwezig, ProfielHalfDikte + 2*75 + LuchtBreedte + ProfielType + 75 + KlimaatRadius, ProfielHalfDikte + 75 + KlimaatRadius)")

# ---- group: Klimaat / Leiding Warm (Boven) / Positie Hart
expression_9 = Expression(
    ProfielType=profieltype_2,
    ProfielHalfDikte=expression_2,
    ElektraAanwezig=elektraaanwezig,
    ElektraHoogte=elektrahoogte,
    KlimaatRadius=expression_7,
    KlimaatDiameter=klimaatdiameter,
    Expression="If(ElektraAanwezig, ProfielHalfDikte + 2*ElektraHoogte + 3*50 + ProfielType + 2*75 + KlimaatDiameter + KlimaatRadius, ProfielHalfDikte + 2*75 + KlimaatDiameter + KlimaatRadius)")

# ---- group: Klimaat / Leiding Koud (Onder) / Positie Hart
expression_10 = Expression(
    ProfielType=profieltype_2,
    ProfielHalfDikte=expression_2,
    ElektraAanwezig=elektraaanwezig,
    ElektraHoogte=elektrahoogte,
    KlimaatRadius=expression_7,
    KlimaatDiameter=klimaatdiameter,
    Expression="If(ElektraAanwezig, ProfielHalfDikte + 2*ElektraHoogte + 3*50 + ProfielType + 75 + KlimaatRadius, ProfielHalfDikte + 75 + KlimaatRadius)")

# ---- group: Klimaat / Leiding Koud (Onder)
construct_point = ConstructPoint(XCoordinate=expression_8, YCoordinate=0, ZCoordinate=expression_10)
unit_y = UnitY(Factor=1)
line_sdl = LineSDL(Start=construct_point, Direction=unit_y, Length=skidlengte)
pipe = Pipe(Curve=line_sdl, Radius=expression_7, Caps=0)
mesh_colours_5 = MeshColours(Mesh=pipe, Colours=ColourSwatch(SwatchColor=RGB(54, 140, 255)))

# ---- group: Klimaat / Leiding Warm (Boven)
unit_y_2 = UnitY(Factor=1)
construct_point_2 = ConstructPoint(XCoordinate=expression_8, YCoordinate=0, ZCoordinate=expression_9)
line_sdl_2 = LineSDL(Start=construct_point_2, Direction=unit_y_2, Length=skidlengte)
pipe_2 = Pipe(Curve=line_sdl_2, Radius=expression_7, Caps=0)
mesh_colours_6 = MeshColours(Mesh=pipe_2, Colours=ColourSwatch(SwatchColor=RGB(171, 0, 0)))

# ---- group: Klimaat (continued)
stream_filter_3 = StreamFilter(Gate=klimaataanwezig, Stream1=[mesh_colours_6, mesh_colours_5])

# ----
expression_11 = Expression(WaterDiameter=waterdiameter, Expression="WaterDiameter / 2")

# ---- group: X Posities / Enkel Lucht
expression_12 = Expression(
    ProfielType=profieltype_2,
    ProfielHalfDikte=expression_2,
    LuchtBreedte=luchtbreedte,
    WaterRadius=expression_11,
    Expression="ProfielHalfDikte + 2*75 + LuchtBreedte + ProfielType + 50 + WaterRadius")

# ---- group: X Posities / Enkel Klimaat
lucht_klimaat = Expression(
    ProfielHalfDikte=expression_2,
    KlimaatDiameter=klimaatdiameter,
    WaterRadius=expression_11,
    Expression="ProfielHalfDikte + 2*75 + KlimaatDiameter + WaterRadius")

# ---- group: X Posities / Geen Lucht & Klimaat
expression_13 = Expression(ProfielHalfDikte=expression_2, WaterRadius=expression_11, Expression="ProfielHalfDikte + 50 + WaterRadius")

# ---- group: X Posities
lucht_klimaat_2 = Expression(
    ProfielType=profieltype_2,
    ProfielHalfDikte=expression_2,
    LuchtBreedte=luchtbreedte,
    KlimaatDiameter=klimaatdiameter,
    WaterRadius=expression_11,
    Expression="ProfielHalfDikte + 2*75 + LuchtBreedte + ProfielType + 2*75 + KlimaatDiameter + WaterRadius")
expression_14 = Expression(
    LuchtAanwezig=luchtaanwezig,
    KlimaatAanwezig=klimaataanwezig,
    GeenLuchtKlimaatPositieX=expression_13,
    LuchtPositieX=expression_12,
    KlimaatPositieX=lucht_klimaat,
    LuchtKlimaatPositieX=lucht_klimaat_2,
    Expression="If(LuchtAanwezig, If(KlimaatAanwezig, LuchtKlimaatPositieX, LuchtPositieX), If(KlimaatAanwezig, KlimaatPositieX, GeenLuchtKlimaatPositieX))")

# ---- group: Water Boven
expression_15 = Expression(
    ProfielType=profieltype_2,
    ProfielHalfDikte=expression_2,
    ElektraAanwezig=elektraaanwezig,
    ElektraHoogte=elektrahoogte,
    WaterRadius=expression_11,
    WaterDiameter=waterdiameter,
    Expression="If(ElektraAanwezig, ProfielHalfDikte + 2*ElektraHoogte + 3*50 + ProfielType + 2*50 + WaterDiameter + WaterRadius, ProfielHalfDikte + 2*50 + WaterDiameter + WaterRadius)")
construct_point_3 = ConstructPoint(XCoordinate=expression_14, YCoordinate=0, ZCoordinate=expression_15)
unit_y_3 = UnitY(Factor=1)
line_sdl_3 = LineSDL(Start=construct_point_3, Direction=unit_y_3, Length=skidlengte)
pipe_3 = Pipe(Curve=line_sdl_3, Radius=expression_11, Caps=0)
mesh_colours_7 = MeshColours(Mesh=pipe_3, Colours=ColourSwatch(SwatchColor=RGB(234, 66, 0)))

# ---- group: Water Onder
expression_16 = Expression(
    ProfielType=profieltype_2,
    ProfielHalfDikte=expression_2,
    ElektraAanwezig=elektraaanwezig,
    ElektraHoogte=elektrahoogte,
    WaterRadius=expression_11,
    WaterDiameter=waterdiameter,
    Expression="If(ElektraAanwezig, ProfielHalfDikte + 2*ElektraHoogte + 3*50 + ProfielType + 50 + WaterRadius, ProfielHalfDikte + 50 + WaterRadius)")
construct_point_4 = ConstructPoint(XCoordinate=expression_14, YCoordinate=0, ZCoordinate=expression_16)
unit_y_4 = UnitY(Factor=1)
line_sdl_4 = LineSDL(Start=construct_point_4, Direction=unit_y_4, Length=skidlengte)
pipe_4 = Pipe(Curve=line_sdl_4, Radius=expression_11, Caps=0)
mesh_colours_8 = MeshColours(Mesh=pipe_4, Colours=ColourSwatch(SwatchColor=RGB(17, 47, 255)))

# ----
stream_filter_4 = StreamFilter(Gate=wateraanwezig, Stream1=[mesh_colours_7, mesh_colours_8])

# ---- group: 1 type leiding / Profielen Lucht
expression_17 = Expression(LuchtHoogte=luchthoogte, Expression="2*LuchtHoogte + 3*75")
# Vrije Ruimten: Lucht                75mm rondom
# Water                50mm rondom
# Verwarming/Koeling   75mm rondom
# Elektra              50mm rondom
# Layout: Lucht links
# Elektra rechtsonder
# Klimaat rechtsboven, linkerhelft
# Water rechtsboven, rechterhelft
# 
# Warme leidingen boven koude leidingen!
# LET OP!: Bij het maken van het frame moet er rekening gehouden worden dat er de verschillen latten vanaf een hart lijn gemaakt worden. Daarom moet alle afstanden hier rekenening mee houden. Zodoende wordt dit genoteerd in de formules als "2*ProfielHalfDikte"
expression_18 = Expression(LuchtBreedte=luchtbreedte, Expression="LuchtBreedte + 2*75")

# ---- group: 1 type leiding / Profielen Klimaat
expression_19 = Expression(KlimaatDiameter=klimaatdiameter, Expression="2*KlimaatDiameter + 3*75")
expression_20 = Expression(KlimaatDiameter=klimaatdiameter, Expression="KlimaatDiameter + 2*75")

# ---- group: 1 type leiding / Profielen Elektra
expression_21 = Expression(ElektraHoogte=elektrahoogte, Expression="2*ElektraHoogte + 3*50")
expression_22 = Expression(ElektraBreedte=elektrabreedte, Expression="Elektrabreedte + 2*50")

# ---- group: 1 type leiding / Profielen Water
expression_23 = Expression(WaterDiameter=waterdiameter, Expression="2*WaterDiameter + 3*50")
expression_24 = Expression(WaterDiameter=waterdiameter, Expression="WaterDiameter + 2*50")

# ---- group: 1 type leiding
number_slider = Slider(0, range=0..100)

# ---- group: 1 type leiding / Profielen Elektra (continued)
stream_filter_5 = StreamFilter(Gate=elektraaanwezig, Stream0=number_slider, Stream1=expression_22)
stream_filter_6 = StreamFilter(Gate=elektraaanwezig, Stream0=number_slider, Stream1=expression_21)

# ---- group: 1 type leiding / Profielen Klimaat (continued)
stream_filter_7 = StreamFilter(Gate=klimaataanwezig, Stream0=number_slider, Stream1=expression_19)
stream_filter_8 = StreamFilter(Gate=klimaataanwezig, Stream0=number_slider, Stream1=expression_20)

# ---- group: 1 type leiding / Profielen Water (continued)
stream_filter_9 = StreamFilter(Gate=wateraanwezig, Stream0=number_slider, Stream1=expression_24)
stream_filter_10 = StreamFilter(Gate=wateraanwezig, Stream0=number_slider, Stream1=expression_23)

# ---- group: 1 type leiding / Profielen Lucht (continued)
stream_filter_11 = StreamFilter(Gate=luchtaanwezig, Stream0=number_slider, Stream1=expression_17)
stream_filter_12 = StreamFilter(Gate=luchtaanwezig, Stream0=number_slider, Stream1=expression_18)

# ---- group: 1 type leiding / Horizontale Ligger?
stream_filter_13 = StreamFilter(Gate=elektraaanwezig, Stream0=number_slider, Stream1=profieltype_2)

# ---- group: 1 type leiding / TussenProfiel?
stream_filter_14 = StreamFilter(Gate=luchtaanwezig, Stream0=number_slider, Stream1=profieltype_2)

# ---- group: 1 type leiding (continued)
x = Expression(KlimaatDiameter=stream_filter_8, WaterDiameter=stream_filter_9, Expression="KlimaatDiameter + Waterdiameter - 50")

# ---- group: 1 type leiding / Breedte Frame
expression_25 = Expression(
    ProfielHalfDikte=expression_2,
    ProfielType=stream_filter_14,
    LuchtBreedte=stream_filter_12,
    KlimaatBreedte=stream_filter_8,
    WaterBreedte=stream_filter_9,
    Expression="ProfielHalfDikte + LuchtBreedte + Profieltype + KlimaatBreedte + WaterBreedte + ProfielHalfDikte")
expression_26 = Expression(
    ProfielHalfDikte=expression_2,
    ProfielType=stream_filter_14,
    LuchtBreedte=stream_filter_12,
    ElektraBreedte=stream_filter_5,
    Expression="ProfielHalfDikte + LuchtBreedte + Profieltype + ElektraBreedte + ProfielHalfDikte")
expression_27 = Expression(x=expression_26, y=expression_25, Expression="If(x ≥ y, x, y)")

# ---- group: 1 type leiding / Hoogte Frame
expression_28 = Expression(
    ProfielHalfDikte=expression_2,
    ProfielType=stream_filter_13,
    ElektraHoogte=stream_filter_6,
    KlimaatHoogte=stream_filter_7,
    Expression="ProfielHalfDikte + ElektraHoogte + Profieltype + KlimaatHoogte + ProfielHalfDikte")
expression_29 = Expression(
    ProfielHalfDikte=expression_2,
    LuchtHoogte=stream_filter_11,
    Expression="ProfielHalfDikte + LuchtHoogte + ProfielHalfDikte")
expression_30 = Expression(x=expression_29, y=expression_28, Expression="If(x ≥ y, x, y)")

# ----
expression_31 = Expression(z=profieltype_2, x=stream_filter_5, y=x, Expression="If(x > y, x + z*2, y + z*2)")

# ---- group: Frame Hoekpunten
construct_point_5 = ConstructPoint(XCoordinate=0, YCoordinate=0, ZCoordinate=0)
unit_y_5 = UnitY(Factor=1)
expression_32 = Expression(SteunPunten=expression, Expression="SteunPunten - 1")
line_sdl_5 = LineSDL(Start=construct_point_5, Direction=unit_y_5, Length=skidlengte)
divide_curve = DivideCurve(Curve=line_sdl_5, Count=expression_32, Kinks=False)  # -> Points, Tangents, Parameters
construct_point_6 = ConstructPoint(XCoordinate=expression_27, YCoordinate=divide_curve.Points, ZCoordinate=expression_30)
construct_point_7 = ConstructPoint(XCoordinate=0, YCoordinate=divide_curve.Points, ZCoordinate=expression_30)
construct_point_8 = ConstructPoint(XCoordinate=expression_27, YCoordinate=divide_curve.Points, ZCoordinate=0)

# ---- group: Frame Lijnen
panel = Panel("""0
1
2
3""")
weave = Weave(
    Pattern=panel,
    Stream0=divide_curve.Points,
    Stream1=construct_point_7,
    Stream2=construct_point_6,
    Stream3=construct_point_8,
    NullGaps=False)
list_length = ListLength(List=weave)
expression_33 = Expression(ListLength=list_length, SteunPunten=expression, Expression="Listlength / SteunPunten")
partition_list = PartitionList(List=weave, Size=expression_33)
list_item = ListItem(List=partition_list, Index=Slider(0, range=0..100), Wrap=True)
merge = Merge(Data1=partition_list, Data2=list_item)
polyline = PolyLine(Vertices=merge, Closed=False)
explode = Explode(Curve=polyline, Recursive=True)  # -> Segments, Vertices
panel_2 = Panel("""True
False""")
dispatch = Dispatch(List=explode.Segments, DispatchPattern=panel_2)  # -> ListA, ListB

# ---- group: Horizontale Stijl
panel_3 = Panel("""True
False""")
negative = Negative(Value=expression_2)
expression_34 = Expression(
    ProfielHalfdikte=expression_2,
    ElektraHoogte=elektrahoogte,
    Expression="ProfielHalfDikte + 3*50 + 2*ElektraHoogte + ProfielHalfDikte")
dispatch_2 = Dispatch(List=dispatch.ListB, DispatchPattern=panel_3)  # -> ListA, ListB
stream_gate = StreamGate(Stream=expression_31, Gate=luchtaanwezig)  # -> Target0, Target1
shatter = Shatter(Curve=dispatch_2.ListB, Parameters=stream_gate.Target1)
panel_4 = Panel("""True
False""")
dispatch_3 = Dispatch(List=shatter, DispatchPattern=panel_4)  # -> ListA, ListB
unit_z = UnitZ(Factor=expression_34)
extend_curve = ExtendCurve(Curve=dispatch_3.ListA, Type=0, Start=negative, End=negative)
transform_5 = Transform(Geometry=extend_curve, Transform=unit_z)
stream_gate_2 = StreamGate(Stream=transform_5, Gate=elektraaanwezig)  # -> Target0, Target1

# ---- group: LengteLiggers
expression_35 = Expression(ProfielHalfDikte=expression_2, Breedte=expression_27, Expression="Breedte + 2*ProfielHalfDikte")
expression_36 = Expression(ProfielHalfDikte=expression_2, Hoogte=expression_30, Expression="Hoogte / 2")
extend_curve_2 = ExtendCurve(Curve=line_sdl_5, Type=0, Start=expression_2, End=expression_2)

# ---- group: LengteLiggers / Links
vector_xyz_5 = VectorXYZ(XComponent=expression_6, YComponent=0, ZComponent=expression_36)  # -> Vector, Length
transform_6 = Transform(Geometry=extend_curve_2, Transform=vector_xyz_5.Vector)

# ---- group: LengteLiggers / Rechts
vector_xyz_6 = VectorXYZ(XComponent=expression_35, YComponent=0, ZComponent=expression_36)  # -> Vector, Length
transform_7 = Transform(Geometry=extend_curve_2, Transform=vector_xyz_6.Vector)

# ---- group: Frame + Gaten
negative_2 = Negative(Value=expression_2)
expression_37 = Expression(ProfielHalfDikte=expression_2, LuchtBreedte=luchtbreedte, Expression="2*ProfielHalfDikte + 2*75 + LuchtBreedte")
extend_curve_3 = ExtendCurve(Curve=dispatch.ListA, Type=0, Start=negative_2, End=negative_2)
extend_curve_4 = ExtendCurve(Curve=dispatch.ListB, Type=0, Start=expression_2, End=expression_2)

# ---- group: Frame + Gaten / Tussen Stijl
panel_5 = Panel("""True
False""")
dispatch_4 = Dispatch(List=extend_curve_3, DispatchPattern=panel_5)  # -> ListA, ListB
vector_xyz_7 = VectorXYZ(XComponent=expression_37, YComponent=0, ZComponent=0)  # -> Vector, Length
transform_8 = Transform(Geometry=dispatch_4.ListA, Transform=vector_xyz_7.Vector)
stream_gate_3 = StreamGate(Stream=transform_8, Gate=luchtaanwezig)  # -> Target0, Target1

# ---- group: Frame + Gaten (continued)
pipe_5 = Pipe(
    Curve=[extend_curve_3, extend_curve_4, stream_gate_3.Target1, stream_gate_2.Target1, transform_7, transform_6],
    Radius=expression_2,
    Caps=0)
bounding_box = BoundingBox(Content=pipe_5, Plane=PlaneXY(0, 0, 0))  # -> Box, Box_2
mesh_colours_9 = MeshColours(Mesh=bounding_box.Box, Colours=ColourSwatch(SwatchColor=RGB(92, 92, 92)))

# ----
context_bake = ContextBake(Content=[mesh_colours_9, stream_filter, stream_filter_2, stream_filter_3, stream_filter_4])
