# Grasshopper definition skid_poc_debugging.gh (Grasshopper 1.0.8)

# ---- group: Inputs / Skid
lengte = Slider(8, range=4..9, expression="x*600")
profieltype = ValueList({"One": 40, "Two": 50, "Three": 90}, selected="One")
skidlengte = GetNumber(lengte, AtLeast=1, AtMost=1, Maximum=1.797693135e+308, Minimum=-1.797693135e+308, TreeAccess=False)
profieltype_2 = GetNumber(profieltype, AtLeast=1, AtMost=1, Maximum=1.797693135e+308, Minimum=-1.797693135e+308, TreeAccess=False)

# ---- group: Inputs / Elektra
hoogte = Slider(10, range=6..10, expression="x*10")
breedte = Slider(60, range=10..60, expression="x*10")
aanwezig = BooleanToggle(True)
elektraaanwezig = GetBoolean(aanwezig, AtLeast=1, AtMost=1, FalseValue="False", TreeAccess=False, TrueValue="True")
elektrahoogte = GetNumber(hoogte, AtLeast=1, AtMost=1, Maximum=1.797693135e+308, Minimum=-1.797693135e+308, TreeAccess=False)
elektrabreedte = GetNumber(breedte, AtLeast=1, AtMost=1, Maximum=1.797693135e+308, Minimum=-1.797693135e+308, TreeAccess=False)

# ---- group: Inputs / Klimaat (Verwarming/Koeling)
diameter = Slider(5, range=1..5, expression="x*50")
aanwezig_2 = BooleanToggle(True)
klimaataanwezig = GetBoolean(aanwezig_2, AtLeast=1, AtMost=1, FalseValue="False", TreeAccess=False, TrueValue="True")
klimaatdiameter = GetNumber(diameter, AtLeast=1, AtMost=1, Maximum=1.797693135e+308, Minimum=-1.797693135e+308, TreeAccess=False)

# ---- group: Inputs / Luchtkanalen
hoogte_2 = Slider(8, range=1..8, expression="x*50")
breedte_2 = Slider(15, range=2..16, expression="x*50")
aanwezig_3 = BooleanToggle(True)
luchtaanwezig = GetBoolean(aanwezig_3, AtLeast=1, AtMost=1, FalseValue="False", TreeAccess=False, TrueValue="True")
luchthoogte = GetNumber(hoogte_2, AtLeast=1, AtMost=1, Maximum=1.797693135e+308, Minimum=-1.797693135e+308, TreeAccess=False)
luchtbreedte = GetNumber(breedte_2, AtLeast=1, AtMost=1, Maximum=1.797693135e+308, Minimum=-1.797693135e+308, TreeAccess=False)

# ---- group: Inputs / Water
diameter_2 = Slider(28, range=12..28)
aanwezig_4 = BooleanToggle(True)
wateraanwezig = GetBoolean(aanwezig_4, AtLeast=1, AtMost=1, FalseValue="False", TreeAccess=False, TrueValue="True")
waterdiameter = GetNumber(diameter_2, AtLeast=1, AtMost=1, Maximum=1.797693135e+308, Minimum=-1.797693135e+308, TreeAccess=False)

# ----
expression = Expression(SkidLengte=skidlengte, Expression="Floor(SkidLengte / 1200)")
expression_2 = Expression(ProfielType=profieltype_2, Expression="ProfielType / 2")

# ---- group: Elektra
expression_3 = Expression(
    ProfielType=profieltype_2,
    ProfielHalfDikte=expression_2,
    LuchtAanwezig=luchtaanwezig,
    LuchtBreedte=luchtbreedte,
    Expression="If(LuchtAanwezig, ProfielHalfDikte + 2*75 + LuchtBreedte + ProfielType + 50 , ProfielHalfDikte + 50)")
expression_4 = Expression(ProfielHalfDikte=expression_2, ElektraHoogte=elektrahoogte, Expression="ProfielHalfDikte + 2*50 + ElektraHoogte")

# ---- group: Lucht / LuchtKanalen / LuchtKanaalBoven / Positie Linksonder
luchtkanaal_onder = Expression(ProfielHalfDikte=expression_2, LuchtHoogte=luchthoogte, Expression="ProfielHalfDikte + 2*75 + LuchtHoogte")
luchtkanaal_onder_2 = Expression(ProfielHalfDikte=expression_2, Expression="ProfielHalfDikte + 75")

# ---- group: Lucht / LuchtKanalen / LuchtKanaal Onder / Positie Linksonder
luchtkanaal_onder_3 = Expression(ProfielHalfDikte=expression_2, Expression="ProfielHalfDikte + 75")

# ---- group: Lucht / LuchtKanalen / LuchtKanaal Onder
domain_box = DomainBox(Base=PlaneXY(0, 0, 0), X=luchtbreedte, Y=skidlengte, Z=luchthoogte)
vector_xyz = VectorXYZ(XComponent=luchtkanaal_onder_3, YComponent=0, ZComponent=luchtkanaal_onder_3)  # -> Vector, Length
transform = Transform(Geometry=domain_box, Transform=vector_xyz.Vector)
mesh_colours = MeshColours(Mesh=transform, Colours=ColourSwatch(SwatchColor=RGB(0, 0, 126)))

# ---- group: Lucht / LuchtKanalen / LuchtKanaalBoven
domain_box_2 = DomainBox(Base=PlaneXY(0, 0, 0), X=luchtbreedte, Y=skidlengte, Z=luchthoogte)
vector_xyz_2 = VectorXYZ(XComponent=luchtkanaal_onder_2, YComponent=0, ZComponent=luchtkanaal_onder)  # -> Vector, Length
transform_2 = Transform(Geometry=domain_box_2, Transform=vector_xyz_2.Vector)
mesh_colours_2 = MeshColours(Mesh=transform_2, Colours=ColourSwatch(SwatchColor=RGB(0, 154, 0)))

# ---- group: Elektra / ElektraLeiding Boven
domain_box_3 = DomainBox(Base=PlaneXY(0, 0, 0), X=elektrabreedte, Y=skidlengte, Z=elektrahoogte)
vector_xyz_3 = VectorXYZ(XComponent=expression_3, YComponent=0, ZComponent=expression_4)  # -> Vector, Length
transform_3 = Transform(Geometry=domain_box_3, Transform=vector_xyz_3.Vector)
mesh_colours_3 = MeshColours(Mesh=transform_3, Colours=ColourSwatch(SwatchColor=RGB(205, 181, 0)))

# ---- group: Elektra / ElektraLeiding Onder
domain_box_4 = DomainBox(Base=PlaneXY(0, 0, 0), X=elektrabreedte, Y=skidlengte, Z=elektrahoogte)
expression_5 = Expression(ProfielHalfDikte=expression_2, Expression="ProfielHalfDikte + 50")
vector_xyz_4 = VectorXYZ(XComponent=expression_3, YComponent=0, ZComponent=expression_5)  # -> Vector, Length
transform_4 = Transform(Geometry=domain_box_4, Transform=vector_xyz_4.Vector)
mesh_colours_4 = MeshColours(Mesh=transform_4, Colours=ColourSwatch(SwatchColor=RGB(205, 181, 0)))

# ---- group: Lucht / LuchtKanalen
stream_filter = StreamFilter(Gate=luchtaanwezig, Stream1=[mesh_colours_2, mesh_colours])

# ---- group: Elektra
stream_filter_2 = StreamFilter(Gate=elektraaanwezig, Stream1=[mesh_colours_3, mesh_colours_4])

# ---- group: Klimaat
expression_6 = Expression(KlimaatDiameter=klimaatdiameter, Expression="KlimaatDiameter / 2")
expression_7 = Expression(
    ProfielType=profieltype_2,
    ProfielHalfDikte=expression_2,
    LuchtAanwezig=luchtaanwezig,
    LuchtBreedte=luchtbreedte,
    KlimaatRadius=expression_6,
    Expression="If (LuchtAanwezig, ProfielHalfDikte + 2*75 + LuchtBreedte + ProfielType + 75 + KlimaatRadius, ProfielHalfDikte + 75 + KlimaatRadius)")

# ---- group: Klimaat / Leiding Warm (Boven) / Positie Hart
expression_8 = Expression(
    ProfielType=profieltype_2,
    ProfielHalfDikte=expression_2,
    ElektraAanwezig=elektraaanwezig,
    ElektraHoogte=elektrahoogte,
    KlimaatRadius=expression_6,
    KlimaatDiameter=klimaatdiameter,
    Expression="If(ElektraAanwezig, ProfielHalfDikte + 2*ElektraHoogte + 3*50 + ProfielType + 2*75 + KlimaatDiameter + KlimaatRadius, ProfielHalfDikte + 2*75 + KlimaatDiameter + KlimaatRadius)")

# ---- group: Klimaat / Leiding Koud (Onder) / Positie Hart
expression_9 = Expression(
    ProfielType=profieltype_2,
    ProfielHalfDikte=expression_2,
    ElektraAanwezig=elektraaanwezig,
    ElektraHoogte=elektrahoogte,
    KlimaatRadius=expression_6,
    KlimaatDiameter=klimaatdiameter,
    Expression="If(ElektraAanwezig, ProfielHalfDikte + 2*ElektraHoogte + 3*50 + ProfielType + 75 + KlimaatRadius, ProfielHalfDikte + 75 + KlimaatRadius)")

# ---- group: Klimaat / Leiding Koud (Onder)
construct_point = ConstructPoint(XCoordinate=expression_7, YCoordinate=0, ZCoordinate=expression_9)
unit_y = UnitY(Factor=1)
line_sdl = LineSDL(Start=construct_point, Direction=unit_y, Length=skidlengte)
pipe = Pipe(Curve=line_sdl, Radius=expression_6, Caps=0)
mesh_colours_5 = MeshColours(Mesh=pipe, Colours=ColourSwatch(SwatchColor=RGB(54, 140, 255)))

# ---- group: Klimaat / Leiding Warm (Boven)
unit_y_2 = UnitY(Factor=1)
construct_point_2 = ConstructPoint(XCoordinate=expression_7, YCoordinate=0, ZCoordinate=expression_8)
line_sdl_2 = LineSDL(Start=construct_point_2, Direction=unit_y_2, Length=skidlengte)
pipe_2 = Pipe(Curve=line_sdl_2, Radius=expression_6, Caps=0)
mesh_colours_6 = MeshColours(Mesh=pipe_2, Colours=ColourSwatch(SwatchColor=RGB(171, 0, 0)))

# ---- group: Klimaat (continued)
stream_filter_3 = StreamFilter(Gate=klimaataanwezig, Stream1=[mesh_colours_6, mesh_colours_5])

# ----
expression_10 = Expression(WaterDiameter=waterdiameter, Expression="WaterDiameter / 2")

# ---- group: X Posities / Enkel Lucht
expression_11 = Expression(
    ProfielType=profieltype_2,
    ProfielHalfDikte=expression_2,
    LuchtBreedte=luchtbreedte,
    WaterRadius=expression_10,
    Expression="ProfielHalfDikte + 2*75 + LuchtBreedte + ProfielType + 50 + WaterRadius")

# ---- group: X Posities / Enkel Klimaat
lucht_klimaat = Expression(
    ProfielHalfDikte=expression_2,
    KlimaatDiameter=klimaatdiameter,
    WaterRadius=expression_10,
    Expression="ProfielHalfDikte + 2*75 + KlimaatDiameter + WaterRadius")

# ---- group: X Posities / Geen Lucht & Klimaat
expression_12 = Expression(ProfielHalfDikte=expression_2, WaterRadius=expression_10, Expression="ProfielHalfDikte + 50 + WaterRadius")

# ---- group: X Posities
lucht_klimaat_2 = Expression(
    ProfielType=profieltype_2,
    ProfielHalfDikte=expression_2,
    LuchtBreedte=luchtbreedte,
    KlimaatDiameter=klimaatdiameter,
    WaterRadius=expression_10,
    Expression="ProfielHalfDikte + 2*75 + LuchtBreedte + ProfielType + 2*75 + KlimaatDiameter + WaterRadius")
expression_13 = Expression(
    LuchtAanwezig=luchtaanwezig,
    KlimaatAanwezig=klimaataanwezig,
    GeenLuchtKlimaatPositieX=expression_12,
    LuchtPositieX=expression_11,
    KlimaatPositieX=lucht_klimaat,
    LuchtKlimaatPositieX=lucht_klimaat_2,
    Expression="If(LuchtAanwezig, If(KlimaatAanwezig, LuchtKlimaatPositieX, LuchtPositieX), If(KlimaatAanwezig, KlimaatPositieX, GeenLuchtKlimaatPositieX))")

# ---- group: Water Boven
expression_14 = Expression(
    ProfielType=profieltype_2,
    ProfielHalfDikte=expression_2,
    ElektraAanwezig=elektraaanwezig,
    ElektraHoogte=elektrahoogte,
    WaterRadius=expression_10,
    WaterDiameter=waterdiameter,
    Expression="If(ElektraAanwezig, ProfielHalfDikte + 2*ElektraHoogte + 3*50 + ProfielType + 2*50 + WaterDiameter + WaterRadius, ProfielHalfDikte + 2*50 + WaterDiameter + WaterRadius)")
construct_point_3 = ConstructPoint(XCoordinate=expression_13, YCoordinate=0, ZCoordinate=expression_14)
unit_y_3 = UnitY(Factor=1)
line_sdl_3 = LineSDL(Start=construct_point_3, Direction=unit_y_3, Length=skidlengte)
pipe_3 = Pipe(Curve=line_sdl_3, Radius=expression_10, Caps=0)
mesh_colours_7 = MeshColours(Mesh=pipe_3, Colours=ColourSwatch(SwatchColor=RGB(234, 66, 0)))

# ---- group: Water Onder
expression_15 = Expression(
    ProfielType=profieltype_2,
    ProfielHalfDikte=expression_2,
    ElektraAanwezig=elektraaanwezig,
    ElektraHoogte=elektrahoogte,
    WaterRadius=expression_10,
    WaterDiameter=waterdiameter,
    Expression="If(ElektraAanwezig, ProfielHalfDikte + 2*ElektraHoogte + 3*50 + ProfielType + 50 + WaterRadius, ProfielHalfDikte + 50 + WaterRadius)")
construct_point_4 = ConstructPoint(XCoordinate=expression_13, YCoordinate=0, ZCoordinate=expression_15)
unit_y_4 = UnitY(Factor=1)
line_sdl_4 = LineSDL(Start=construct_point_4, Direction=unit_y_4, Length=skidlengte)
pipe_4 = Pipe(Curve=line_sdl_4, Radius=expression_10, Caps=0)
mesh_colours_8 = MeshColours(Mesh=pipe_4, Colours=ColourSwatch(SwatchColor=RGB(17, 47, 255)))

# ----
stream_filter_4 = StreamFilter(Gate=wateraanwezig, Stream1=[mesh_colours_7, mesh_colours_8])

context_bake = ContextBake(Content=[stream_filter, stream_filter_2, stream_filter_3, stream_filter_4])
