# Grasshopper definition stalenbalk_web_configurator.gh (Grasshopper 1.0.8)

H = Slider(8, range=0..10)
tw = Slider(0.25, range=0.25..1)
B = Slider(5, range=0..10)
lengte = Slider(16, range=0..110)
tf = Slider(1, range=0.25..1)

number_slider = Slider(1, range=-1..1)
number_slider_2 = Slider(0, range=0..100)
H_2 = GetNumber(H, AtLeast=1, AtMost=1, Maximum=1.797693135e+308, Minimum=-1.797693135e+308, TreeAccess=False)
lengte_2 = GetNumber(lengte, AtLeast=1, AtMost=1, Maximum=1.797693135e+308, Minimum=-1.797693135e+308, TreeAccess=False)
B_2 = GetNumber(B, AtLeast=1, AtMost=1, Maximum=1.797693135e+308, Minimum=-1.797693135e+308, TreeAccess=False)
tf_2 = GetNumber(tf, AtLeast=1, AtMost=1, Maximum=1.797693135e+308, Minimum=-1.797693135e+308, TreeAccess=False)
tw_2 = GetNumber(tw, AtLeast=1, AtMost=1, Maximum=1.797693135e+308, Minimum=-1.797693135e+308, TreeAccess=False)
vector_xyz = VectorXYZ(XComponent=number_slider_2, YComponent=H_2, ZComponent=number_slider_2)  # -> Vector, Length
vector_xyz_2 = VectorXYZ(XComponent=number_slider_2, YComponent=number_slider_2, ZComponent=number_slider_2)  # -> Vector, Length
vector_xyz_3 = VectorXYZ(XComponent=number_slider, YComponent=number_slider_2, ZComponent=number_slider_2)  # -> Vector, Length
number_slider_3 = Slider(1, range=0..1)
expression = Expression(x=H_2, y=tf_2, Expression="x-(2*y)")
vector_xyz_4 = VectorXYZ(XComponent=number_slider_2, YComponent=number_slider, ZComponent=number_slider_2)  # -> Vector, Length
negative = Negative(Value=tf_2)
line_sdl = LineSDL(Start=vector_xyz.Vector, Direction=vector_xyz_3.Vector, Length=B_2)
line_sdl_2 = LineSDL(Start=vector_xyz_2.Vector, Direction=vector_xyz_3.Vector, Length=B_2)
divide_curve = DivideCurve(Curve=line_sdl, Count=number_slider_3, Kinks=False)  # -> Points, Tangents, Parameters
divide_curve_2 = DivideCurve(Curve=line_sdl_2, Count=number_slider_3, Kinks=False)  # -> Points, Tangents, Parameters
number_slider_4 = Slider(0, range=0..2)
number_slider_5 = Slider(1, range=0..2)
offset_curve = OffsetCurve(Curve=line_sdl_2, Distance=negative, Corners=1)
number_slider_6 = Slider(2, range=0..10)
negative_2 = Negative(Value=tw_2)
offset_curve_2 = OffsetCurve(Curve=line_sdl, Distance=tf_2, Corners=1)
list_item = ListItem(List=divide_curve_2.Points, Index=number_slider_5, Wrap=True)
list_item_2 = ListItem(List=divide_curve_2.Points, Index=number_slider_4, Wrap=True)
list_item_3 = ListItem(List=divide_curve.Points, Index=number_slider_5, Wrap=True)
list_item_4 = ListItem(List=divide_curve.Points, Index=number_slider_4, Wrap=True)
divide_curve_3 = DivideCurve(Curve=offset_curve_2, Count=number_slider_6, Kinks=False)  # -> Points, Tangents, Parameters
divide_curve_4 = DivideCurve(Curve=offset_curve, Count=number_slider_6, Kinks=False)  # -> Points, Tangents, Parameters
list_item_5 = ListItem(List=divide_curve_4.Points, Index=Slider(1, range=0..1), Wrap=True)
line_sdl_3 = LineSDL(Start=list_item_5, Direction=vector_xyz_4.Vector, Length=expression)
offset_curve_3 = OffsetCurve(Curve=line_sdl_3, Distance=tw_2, Corners=1)
offset_curve_4 = OffsetCurve(Curve=line_sdl_3, Distance=negative_2, Corners=1)
number_slider_7 = Slider(0, range=0..2)
number_slider_8 = Slider(2, range=0..2)
line_line = LineLine(Line1=offset_curve_2, Line2=offset_curve_4)  # -> ParamA, ParamB, PointA, PointB
line_line_2 = LineLine(Line1=offset_curve, Line2=offset_curve_4)  # -> ParamA, ParamB, PointA, PointB
line_line_3 = LineLine(Line1=offset_curve, Line2=offset_curve_3)  # -> ParamA, ParamB, PointA, PointB
list_item_6 = ListItem(List=divide_curve_3.Points, Index=number_slider_7, Wrap=True)
line_line_4 = LineLine(Line1=offset_curve_2, Line2=offset_curve_3)  # -> ParamA, ParamB, PointA, PointB
list_item_7 = ListItem(List=divide_curve_4.Points, Index=number_slider_7, Wrap=True)
list_item_8 = ListItem(List=divide_curve_4.Points, Index=number_slider_8, Wrap=True)
list_item_9 = ListItem(List=divide_curve_3.Points, Index=number_slider_8, Wrap=True)
line = Line(StartPoint=line_line_3.PointA, EndPoint=list_item_8)
line_2 = Line(StartPoint=line_line_4.PointA, EndPoint=line_line_3.PointA)
line_3 = Line(StartPoint=list_item_9, EndPoint=line_line_4.PointA)
line_4 = Line(StartPoint=line_line_2.PointA, EndPoint=list_item_7)
line_5 = Line(StartPoint=line_line.PointA, EndPoint=line_line_2.PointA)
line_6 = Line(StartPoint=list_item_6, EndPoint=line_line.PointA)
merge = Merge(Data1=line_3, Data2=line_2, Data3=line)
merge_2 = Merge(Data1=line_6, Data2=line_5, Data3=line_4)
fillet = Slider(2, range=0..100)
fillet_2 = Slider(0.342, range=-0.001..1)
join_curves = JoinCurves(Curves=merge, Preserve=False)
join_curves_2 = JoinCurves(Curves=merge_2, Preserve=False)
fillet_3 = Fillet(Curve=join_curves_2, Parameter=fillet, Radius=fillet_2)  # -> Curve, Parameter
fillet_4 = Fillet(Curve=join_curves, Parameter=fillet, Radius=fillet_2)  # -> Curve, Parameter
line_7 = Line(StartPoint=list_item_3, EndPoint=list_item_9)
line_8 = Line(StartPoint=list_item_8, EndPoint=list_item)
line_9 = Line(StartPoint=list_item_7, EndPoint=list_item_2)
line_10 = Line(StartPoint=list_item_4, EndPoint=list_item_6)
fillet_5 = Fillet(Curve=fillet_3.Curve, Parameter=fillet, Radius=fillet_2)  # -> Curve, Parameter
fillet_6 = Fillet(Curve=fillet_4.Curve, Parameter=fillet, Radius=fillet_2)  # -> Curve, Parameter
join_curves_3 = JoinCurves(Curves=flatten([line_7, line_8, line_10, line_9, fillet_6.Curve, fillet_5.Curve, line_sdl, line_sdl_2]), Preserve=False)
vector_xyz_5 = VectorXYZ(XComponent=0, YComponent=0, ZComponent=lengte_2)  # -> Vector, Length
boundary_surfaces = BoundarySurfaces(Edges=join_curves_3)
extrude = Extrude(Base=boundary_surfaces, Direction=vector_xyz_5.Vector)
mesh = Mesh(extrude)
context_bake = ContextBake(Content=mesh)
